test file "DC_Motor_Simscape_ClosedLoop_Tests"
  coverage: Decision, MCDC, Condition

suite "Requirements"

  case "REQ_DCM_009_600rpm_step_response" [simulation]
    description: Draft performance requirement derived from the requested 600 rpm step-response acceptance criteria. The speed output is assessed against the 600 rpm target using the measured speed_rpm signal. Note: the current tuned model previously measured approximately 0% overshoot and 2.5113 ms settling time, so this requirement is intentionally stricter than the current implementation.
    model DC_Motor_Simscape_ClosedLoop, mode Normal, stop time 0.5
    logged signals "Assessment Signals" (off): RadPerSec_to_RPM:1
    logged signals "Assessment Signals1": RadPerSec_to_RPM:1
    assessment "OvershootLessThan5Percent": At any point of time, whenever t >= 0.05 is true then, with no delay, speed_rpm <= 630 must be true
    assessment "SettledWithin10msAfterStep": At any point of time, whenever t >= 0.060 is true then, with no delay, abs(speed_rpm - 600) <= 30 must be true
      speed_rpm: expression sltest_simout.logsout.getElement(1).Values